# Dynamo graph DynamoTest1.dyn (Dynamo 0.8.2.2392)

string = StringInput("DynamoTest1")
string_2 = StringInput("Testing Dynamo export to Hydra repo.")
string_3 = StringInput("Version1")
string_4 = StringInput("test, dynamo, hydra, export")
directory_path = Directory("C:\Users\Keith\Documents\GitHub\hydra")
hydraShare = HydraShare(string, string_2, string_3, string_4, directory_path)
string_5 = StringInput("""Hydra
Welcomes 
Dynamo""")
code_block = CodeBlock { 500; }
byCoordinates = Point.ByCoordinates(x=code_block, y=code_block, z=code_block)
code_block_2 = CodeBlock { 100; }
fromStringOriginAndScale = DynamoText.Text.FromStringOriginAndScale(string_5, byCoordinates, code_block_2)
watch_3d = Watch3D(fromStringOriginAndScale)
file_path = Filename("C:\Users\Keith\Desktop\Hydra\hydra_logo.png")
fromPath = FileObject(file_path)  # "File.FromPath"
readFromFile = Image.ReadFromFile(fromPath)
watch_image = WatchImageCore(readFromFile)
